# Grasshopper definition column-placement.gh (Grasshopper 1.0.7)
# plug-ins: ScriptParasite

# You will need to set the assembly
# reference location to your copy of
# KangarooSolver.dll
# Do this by right-clicking and then
# Manage Assemblies
# "C:\Program Files\Rhino 7\Plug-ins\Grasshopper\Components\KangarooSolver.dll"
panel = Panel("C:\Users\danie\source\repos\column-placement")
crv = Curve(<curve referenced from the Rhino model>)
crv_2 = Curve(<curve referenced from the Rhino model>)
pt = Point([<point referenced from the Rhino model> x2])

c_script = CSharpScript(
    boundary=crv,
    offset=Slider(0.1, range=0..1),
    negative=crv_2,
    fixedColumns=pt,
    numberColumns=Slider(34, range=0..100),
    fixedWalls=crv_2,
    radius=Slider(2.02, range=0..10),
    reset=Button(),
    run=Toggle(False),
    Reference="C:\Program Files\Rhino 7\Plug-ins\Grasshopper\Components\KangarooSolver.dll")  # -> out, points, iterations; inputs boundary: Curve, offset: Double, negative: list of Curve, fixedColumns: list of Point3d, numberColumns: Int32, fixedWalls: list of Curve, radius: Double, reset: Boolean, run: Boolean
# ---------- c_script: C# usings ----------
using System.IO;
using System.Linq;
using System.Data;
using System.Drawing;
using System.Reflection;
using System.Windows;
using System.Xml;
using System.Xml.Linq;
using System.Runtime.InteropServices;
using Rhino.DocObjects;
using Rhino.Collections;
using GH_IO;
using GH_IO.Serialization;
using KangarooSolver;
using KangarooSolver.Goals;
using Rhino.Render.ChangeQueue;
using Rhino.Runtime.InProcess;
using Rhino.Render;
# ---------- c_script: C# ----------
    /*
        //add the goals to the solver
        foreach (IGoal goal in allGoals)
        {
          PS.AssignPIndex(goal, 0.0001);
          Print(goal.ToString());
        }
    */

    if (reset || PS.ParticleCount() > numberColumns)
    {
      PS.ClearParticles();
      allGoals.Clear();
      counter = 0;

      //get brep boundary
      Brep brepBoundary = getBoundary(offset, boundary, negative);

      //get columns
      allColumns = getColumns(brepBoundary, numberColumns, fixedColumns);

      //convert brep to mesh
      Rhino.Geometry.Mesh meshBoundary = Rhino.Geometry.Mesh.CreateFromBrep(brepBoundary, MeshingParameters.Default)[0];

      //get goals
      allGoals = getGoals(allColumns, fixedColumns, fixedWalls, meshBoundary, radius);

      foreach (IGoal goal in allGoals) //Assign indexes to the particles in each Goal:
      {
        PS.AssignPIndex(goal, 0.0001); // the second argument is the tolerance distance below which points combine into a single particle
        Print(goal.ToString());
      }
    } else
    {
      //get brep boundary
      Brep brepBoundary = getBoundary(offset, boundary, negative);

      //get columns
      allColumns = getColumns(brepBoundary, numberColumns, fixedColumns);

      //convert brep to mesh
      Rhino.Geometry.Mesh meshBoundary = Rhino.Geometry.Mesh.CreateFromBrep(brepBoundary, MeshingParameters.Default)[0];

      //get goals
      allGoals = getGoals(allColumns, fixedColumns, fixedWalls, meshBoundary, radius);

      foreach (IGoal goal in allGoals) //Assign indexes to the particles in each Goal:
      {
        PS.AssignPIndex(goal, 0.0001); // the second argument is the tolerance distance below which points combine into a single particle
        //Print(goal.ToString());
      }
    }


    int substeps = 5;

    if (run) //PS.GetvSum() > 1e-15 &&
    {
      PS.MomentumStep(allGoals, 0.99, substeps);
      counter += substeps;
      Component.ExpireSolution(true);
    }

    //get the positions of the points
    points = PS.GetPositions();

    //get the number of iterations
    iterations = PS.GetIterations();

    //Print(allGoals.Count.ToString());
# ---------- c_script: C# additional code ----------
  List<Point3d> allColumns = new List<Point3d>();
  KangarooSolver.PhysicalSystem PS = new KangarooSolver.PhysicalSystem();
  List<IGoal> allGoals = new List<IGoal>();
  int counter = 0;
  //double threshold = 1e-15;

  public Brep getBoundary(double offset, Curve boundary, List<Curve> negative)
  {
    //if offset is positive, then make it negative
    if (offset > 0)
    {
      offset = offset * -1;
    }

    //if offset != 0, then offset the boundary
    if (offset != 0)
    {
      boundary = boundary.Offset(Plane.WorldXY, offset, 0.5, CurveOffsetCornerStyle.Sharp)[0];
    }

    //array size is equal the size of negative list + 1
    Curve[] boundaryCurves = new Curve[negative.Count + 1];
    boundaryCurves[0] = boundary;
    for (int i = 0; i < negative.Count; i++)
    {
      boundaryCurves[i + 1] = negative[i];
    }

    //generate a surface with offseted boundary
    Brep brepBoundary = Brep.CreatePlanarBreps(boundaryCurves, 0.5)[0];

    return brepBoundary;
  }
 
  private List<Point3d> getColumns(Brep brepBoundary, int numberColumns, List<Point3d> fixedColumns)
  {
    //find the center of the boundary
    Point3d center = brepBoundary.GetBoundingBox(false).Center;

    //create a circle at the center of the boundary
    Circle circle = new Circle(center, 0.1);

    //convert the circle to a nurbs curve
    Curve circleCurve = circle.ToNurbsCurve();

    //divide the circle into numberAddColumns
    int numberAddColumns = numberColumns - fixedColumns.Count;

    //create array for extra columns
    Point3d[] addColumns = new Point3d[numberAddColumns];
    double[] test = circleCurve.DivideByCount(numberAddColumns, true, out addColumns);

    //create a list of all columns
    List<Point3d> allColumns = addColumns.ToList();
    for (int i = 0; i < fixedColumns.Count; i++)
    {
      allColumns.Add(fixedColumns[i]);
    }

    return allColumns;
  }
  
  private List<IGoal> getGoals(List<Point3d> allColumns, List<Point3d> fixedColumns, List<Curve> fixedWalls, Rhino.Geometry.Mesh meshBoundary, double radius)
  {
    //onmesh goal
    OnMesh onMesh = new OnMesh(allColumns, meshBoundary, 1000);
    allGoals.Add(onMesh);

    //sphere collide goal
    SphereCollide sphereCollide = new SphereCollide(allColumns, radius, 1);
    allGoals.Add(sphereCollide);

    //anchor goal
    for (int i = 0; i < fixedColumns.Count; i++)
    {
      Anchor anchor = new Anchor(fixedColumns[i], 1000);
      allGoals.Add(anchor);
    }

    //Add fixedWalls constraint here
/*
    List<object> collideList = new List<object>();
    collideList.Add(allColumns);
    collideList.Add(fixedWalls);
    List<double> radiusCollide = new List<double>();
    for (int i = 0; i < collideList.Count; i++)
    {
      radiusCollide.Add(radius);
    }
    Collider collide = new Collider(collideList, radiusCollide, null, null, 1);*/

    return allGoals;
  }
# ---------- end c_script ----------
scriptpar = ScriptParasite(Enable=Toggle(True), Folder=panel)

panel_2 = Panel(c_script.out)
panel_3 = Panel(c_script.iterations)
con = DelaunayEdges(Points=c_script.points, Plane=PlaneXY(0, 0, 0))  # -> Connectivity, Edges; disabled
panel_4 = Panel(c_script.points)
crv_3 = Curve(con.Edges)  # disabled
